# Grasshopper definition Grasshopper L10 Bracelet.gh (Grasshopper 1.0.7)

curve = Curve(<curve referenced from the Rhino model>)
crv = Curve(<curve referenced from the Rhino model>)
perp_frames = PerpFrames(Curve=curve, Count=Slider(3, range=0..10), Align=True)  # -> Frames, Parameters
pframes = PerpFrames(Curve=crv, Count=Slider(3, range=0..10), Align=Toggle(True))  # -> Frames, Parameters
polygon = Polygon(
    Plane=perp_frames.Frames,
    Radius=Slider(6, range=0..10),
    Segments=Slider(6, range=0..10),
    FilletRadius=Slider(0, range=0..1))  # -> Polygon, Length
polygon_2 = Polygon(
    Plane=pframes.Frames,
    Radius=Slider(6, range=0..10),
    Segments=Slider(6, range=0..10),
    FilletRadius=Slider(1, range=0..10))  # -> Polygon, Length
explode = Explode(Curve=polygon.Polygon, Recursive=True)  # -> Segments, Vertices
loft = Loft(Curves=polygon.Polygon, Options={Adjust=False, Closed=True, LoftEnds=0, LoftSimp=0, LoftType=0, Rebuild=10, Refit=0.01})
explode_2 = Explode(Curve=polygon_2.Polygon, Recursive=True)  # -> Segments, Vertices
loft_2 = Loft(
    Curves=polygon_2.Polygon,
    Options={Adjust=False, Closed=True, LoftEnds=0, LoftSimp=0, LoftType=0, Rebuild=10, Refit=0.01})
point_list = PointList(Points=explode.Vertices, Size=Slider(2, range=0..10))
points = PointList(Points=explode_2.Vertices, Size=Slider(2, range=0..10))
