# Grasshopper definition Voronoi Pattern Basket.gh (Grasshopper 1.0.7)

surface = Surface(<surface referenced from the Rhino model>)
dimensions = Dimensions(Surface=surface)  # -> UDimension, VDimension
plane_surface = PlaneSurface(Plane=PlaneXY(0, 0, 0), XSize=dimensions.UDimension, YSize=dimensions.VDimension)
populate_geometry = PopulateGeometry(Geometry=plane_surface, Count=100, Seed=1)
voronoi = Voronoi(Points=populate_geometry, Boundary=plane_surface, BruteForceOverride=False)
area = Area(Geometry=voronoi)  # -> Area, Centroid
scale = Scale(Geometry=voronoi, Center=area.Centroid, Factor=Slider(0.8, range=0..1))  # -> Geometry, Transform
surface_split = SurfaceSplit(Surface=plane_surface, Curves=scale.Geometry)
merge = Merge(Data1=graft(voronoi), Data2=graft(scale.Geometry))
unit_z = UnitZ(Factor=Slider(1, range=0..1))
loft = Loft(Curves=merge, Options={Adjust=False, Closed=False, LoftEnds=0, LoftSimp=0, LoftType=0, Rebuild=10, Refit=0.01})
area_2 = Area(Geometry=surface_split)  # -> Area, Centroid
surface_2 = Surface(surface)
sort_list = SortList(Keys=area_2.Area, ValuesValuesA=area_2.Centroid)  # -> Keys, ValuesValuesA
extrude = Extrude(Base=loft, Direction=unit_z)
bounding_box = BoundingBox(Content=flatten(extrude), Plane=PlaneXY(0, 0, 0), UnionBox=True)  # -> Box, Box_2
list_item = ListItem(List=reverse(sort_list.ValuesValuesA), Index=0, Wrap=True)
surface_morph = SurfaceMorph(
    Geometry=extrude,
    Reference=bounding_box.Box,
    Surface=reparameterize(surface_2),
    UDomain="0 to 1",
    VDomain="0 to 1",
    WDomain="0 to 1")
