# Grasshopper definition Voronoi Pattern Exploration.gh (Grasshopper 1.0.7)
# plug-ins: Weaverbird

number_slider = Slider(0.979, range=0..10)  # disabled
number_slider_2 = Slider(59, range=0..100)  # disabled
srf = Surface(<surface referenced from the Rhino model>)  # disabled
pt = Point([<point referenced from the Rhino model> x12])  # disabled
srf_cp = SurfaceClosestPoint(Point=pt, Surface=srf)  # -> Point, UVPoint, Distance; disabled
scale = Scale(Geometry=srf, Center=Point(0, 0, 0), Factor=number_slider)  # -> Geometry, Transform; disabled
popgeo = PopulateGeometry(Geometry=srf, Count=number_slider_2, Seed=1, Points=srf_cp.Point)  # disabled
bbox = BoundingBox(Content=scale.Geometry, Plane=PlaneXY(0, 0, 0))  # -> Box, Box_2; disabled
panel = Panel(popgeo)  # disabled
voronoi³ = Voronoi3D(Points=popgeo, Box=bbox.Box)  # -> Cells, Boundary; disabled
bbx = BrepBrep(BrepA=srf, BrepB=voronoi³.Cells)  # -> Curves, Points; disabled
disc = Discontinuity(Curve=bbx.Curves, Level=1)  # -> Points, Parameters; disabled
number_slider_3 = Slider(0.7, range=0..1)  # disabled
avr = Average(Input=disc.Points)  # disabled
pline = PolyLine(Vertices=disc.Points, Closed=True)  # disabled
scale_2 = Scale(Geometry=pline, Center=avr, Factor=number_slider_3)  # -> Geometry, Transform; disabled
merge = Merge(Data1=graft(pline), Data2=graft(scale_2.Geometry))  # disabled
loft = Loft(Curves=merge, Options={Adjust=False, Closed=False, LoftEnds=0, LoftSimp=0, LoftType=0, Rebuild=10, Refit=0.01})  # disabled
debrep = DeconstructBrep(Brep=loft)  # -> Faces, Edges, Vertices; disabled
number_slider_4 = Slider(2, range=0..10)  # disabled
mesh_uv = MeshSurface(Surface=debrep.Faces, UCount=5, VCount=5, Overhang=True, Equalize=False)  # -> flatten(Mesh); disabled
number_slider_5 = Slider(1.6, range=0..10)  # disabled
wbjoin = WeaverbirdsJoinMeshesAndWeld(Mesh=mesh_uv, Weld=False)  # disabled
wbcatmullclark = WeaverbirdsCatmullClarkSubdivision(MeshCurves=wbjoin, Level=number_slider_5, SmoothNakedEdges=1)  # disabled
wbthicken = WeaverbirdsMeshThicken(MeshCurves=wbcatmullclark, Distance=number_slider_4, OffsetType=0)  # disabled
preview = CustomPreview(
    Geometry=wbthicken,
    Material={diffuse=RGB(221, 160, 221), emission=RGB(66, 48, 66), shine=0.5, specular=RGB(255, 255, 255), transparency=0})  # disabled

srf_2 = Surface(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)
dim = Dimensions(Surface=srf_2)  # -> UDimension, VDimension
planesrf = PlaneSurface(Plane=PlaneXY(0, 0, 0), XSize=dim.UDimension, YSize=dim.VDimension)
crv = Curve([<curve referenced from the Rhino model> x3])
popgeo_2 = PopulateGeometry(Geometry=planesrf, Count=Slider(39, range=0..100), Seed=1)
divide = DivideCurve(Curve=crv, Count=Slider(18, range=0..100), Kinks=False)  # -> Points, Tangents, Parameters
merge_2 = Merge(Data1=popgeo_2, Data2=divide.Points)  # -> flatten(Result)
voronoi = Voronoi(Points=merge_2, Boundary=planesrf, BruteForceOverride=False)
debrep_2 = DeconstructBrep(Brep=voronoi)  # -> Faces, Edges, Vertices
nurbs = NurbsCurve(Vertices=debrep_2.Vertices, Degree=Slider(2, range=0..10), Periodic=True)  # -> Curve, Length, Domain
area = Area(Geometry=nurbs.Curve)  # -> Area, Centroid
scale_3 = Scale(Geometry=nurbs.Curve, Center=area.Centroid, Factor=Slider(0.8, range=0..1))  # -> Geometry, Transform
merge_3 = Merge(Data1=graft(nurbs.Curve), Data2=graft(scale_3.Geometry))
loft_2 = Loft(Curves=merge_3, Options={Adjust=False, Closed=False, LoftEnds=0, LoftSimp=0, LoftType=0, Rebuild=10, Refit=0.01})
Z = UnitZ(Factor=1)
extr = Extrude(Base=loft_2, Direction=Z)
bbox_2 = BoundingBox(Content=flatten(extr), Plane=PlaneXY(0, 0, 0), UnionBox=True)  # -> Box, Box_2
srfmorph = SurfaceMorph(Geometry=extr, Reference=bbox_2.Box, Surface=reparameterize(srf_2), UDomain="0 to 1", VDomain="0 to 1", WDomain="0 to 1")
volume = Volume(Geometry=srfmorph)  # -> Volume, Centroid
mesh = MeshBrep(
    Brep=srfmorph,
    Settings={GridMaxCount=0, GridMinCount=16, JaggedSeams=False, MaxEdgeLength=0, MinEdgeLength=0.0001, MinTolerance=0, Refine=True, RefineAngle=0, RelativeTolerance=0.65, SimplePlanes=True, Tolerance=0})  # -> flatten(Mesh)
demesh = DeconstructMesh(Mesh=mesh)  # -> Vertices, Faces, Colours, Normals
bnd = Bounds(Numbers=flatten(volume.Volume))
pdecon = Deconstruct(Point=demesh.Vertices)  # -> XComponent, YComponent, ZComponent
dedomain = DeconstructDomain(Domain=bnd)  # -> Start, End
flatten = FlattenTree(Tree=pdecon.ZComponent, Path="{0}")
bnd_2 = Bounds(Numbers=flatten)
dedomain_2 = DeconstructDomain(Domain=bnd_2)  # -> Start, End
gradient = Gradient(
    LowerLimit=dedomain.Start,
    UpperLimit=dedomain.End,
    Parameter=volume.Volume,
    stops=[0.0556: RGB(206, 239, 219), 0.477: RGB(153, 188, 222), 1: RGB(77, 165, 215)])
gradient_2 = Gradient(
    LowerLimit=dedomain_2.Start,
    UpperLimit=dedomain_2.End,
    Parameter=pdecon.ZComponent,
    stops=[0.15: RGB(255, 130, 160), 0.85: RGB(220, 0, 40)])
conmesh = ConstructMesh(Vertices=demesh.Vertices, Faces=demesh.Faces, Colours=gradient_2)
conmesh_2 = ConstructMesh(Vertices=demesh.Vertices, Faces=demesh.Faces, Colours=gradient)
