# Grasshopper definition bracelet2.gh (Grasshopper 1.0.7)

crv = Curve(<curve referenced from the Rhino model>)
pframes = PerpFrames(Curve=crv, Count=Slider(3, range=0..10), Align=True)  # -> Frames, Parameters
polygon = Polygon(Plane=pframes.Frames, Radius=Slider(7, range=0..10), Segments=Slider(6, range=0..10), FilletRadius=Slider(2, range=0..5))  # -> Polygon, Length
loft = Loft(Curves=polygon.Polygon, Options={Adjust=False, Closed=True, LoftEnds=0, LoftSimp=0, LoftType=0, Rebuild=10, Refit=0.01})
explode = Explode(Curve=polygon.Polygon, Recursive=True)  # -> Segments, Vertices
points = PointList(Points=explode.Vertices, Size=Slider(2, range=0..10))
